# Dynamo graph dynamo.dyn (Dynamo 1.0.0.1180)

views = Views("Drafting 3")
reDraw = BoolSelector(true)
elementsInView = Custom[Collector.ElementsInView](view_s=views, refresh=reDraw)  # Selects all elements visible in the input view.
number = DoubleInput(0)
removeItemAtIndex = List.RemoveItemAtIndex(list=elementsInView, indices=number)
deleteElements = Custom[Doc.DeleteElements](element_s=removeItemAtIndex)  # Attempts to delete the input list of elements from the active Revit document.The node returns the number of successfully deleted elements and their Ids as a string. Carefully observe the deleted elements count. It may be greater than the input list because hosted elements or tags will be deleted as well. If an element in the list can not be deleted (for example last revision or last view), the whole list will fail to be deleted.
file_path = Filename("..\DynamoBarChart.py")
wait = Custom[Input.Wait](WaitForMe=deleteElements.count, Output=file_path)  # Waits for all inputs to be completed before continuing the execution process.Part of the SmartCopyMon workflow.
readText = File.ReadText(wait)
number_2 = DoubleInput(0.01)
roundToPrecision = Custom[Math.RoundToPrecision](precision=number_2)  # Rounds a number to a specified precision
number_3 = DoubleInput(0)
le = roundToPrecision <= number_3
filterByBoolMask = List.FilterByBoolMask(list=roundToPrecision, mask=le)
flatten = Flatten(filterByBoolMask.out)
views_2 = Views("Room Schedule Copy 1")
views_3 = Views("Drafting 3")
python_script_from_string = PythonStringNode(script=readText, IN[0]=flatten, IN[1]=views_2, IN[2]=views_3)
code_block = CodeBlock { {1..5..0.1}; }
code_block_2 = CodeBlock { {1,3,5,6,3,2,3,4,5,4.2,3.1,2.2}; }
code_block_3 = CodeBlock { 20..1600..20; 4; }
code_block_4 = CodeBlock(scale=code_block_3.out1, x=code_block_3.out0) { scale*(1-Math.Sin(x)); }
code_block_5 = CodeBlock(x=code_block, y=code_block_2, z=code_block_4) { x; y; z; }
active_view = Custom[Active View]()  # Selects the current document's active view. Supports more view types than the built-in option. Will be depreciated once the bult in node works with all plan types.
